# Grasshopper definition planfinder_dataset_adapt.gh (Grasshopper 1.0.8)
# plug-ins: PlanFinderGH

button = Button()
trigger = Trigger(Interval=500, TimerInterval=500, Target=counter)  # disabled
json_dataset_path_planfinder = Panel("C:\Users\mosmo\OneDrive\Desktop\AIA Studio\AIA26_Studio\team_06\layout_inputs\Planfinder_Dataset")  # disabled
number_slider = Slider(0, range=0..44)  # disabled
python_3_script = Python3Script(folder_path=json_dataset_path_planfinder)  # -> out, items; inputs folder_path: String; disabled
# ---------- python_3_script: Python ----------
import os
files = sorted([
    os.path.join(folder_path, f)
    for f in os.listdir(folder_path)
    if f.endswith(".json")
])
a = files
# ---------- end python_3_script ----------
list_item = ListItem(List=python_3_script.items, Index=number_slider, Wrap=True)  # disabled
panel = Panel(python_3_script.items)  # disabled
read_file = ReadFile(File=list_item, PerLineParse=False)  # disabled
planfinder_schema_to_geo = Python3Script(json_str=read_file)  # -> out, outline_curve, room_programs, room_curves, circulation_curves, door_names, door_points, a; inputs json_str: String; disabled
# ---------- planfinder_schema_to_geo: Python ----------
import json
import Rhino.Geometry as rg

data = json.loads(json_str)
out = data.get("layoutId", "unknown")

# Boundary
bnd_pts = [rg.Point3d(p[0], p[1], 0) for p in data["boundary"]]
bnd_pts.append(bnd_pts[0])
outline_curve = rg.PolylineCurve(bnd_pts)

# Rooms
room_curves, room_programs, room_names, circulation_curves = [], [], [], []
for room in data.get("rooms", []):
    pts = [rg.Point3d(p[0], p[1], 0) for p in room["geometry"]]
    crv = rg.PolylineCurve(pts)
    prog = room["attributes"].get("program", "").lower()
    room_curves.append(crv)
    room_programs.append(prog)
    room_names.append(room.get("name", ""))
    if prog == "circulation":
        circulation_curves.append(crv)

# Doors
door_points, door_names = [], []
for door in data.get("doors", []):
    g = door["geometry"][0]
    door_points.append(rg.Point3d(g[0], g[1], 0))
    door_names.append(door.get("name", ""))

# Empty outputs to match RPLAN interface
window_curves, window_names = [], []
furniture_curves, furniture_names = [], []
facade_curves = []
# ---------- end planfinder_schema_to_geo ----------
path = FilePath("D:\Marina\MaCAD 2025\3 SEMESTER\STUDIO\planfinder dataset\planfinder_blacklist.txt")

# ----
# RPLAN JSON Dataset
number_slider_2 = Slider(1364, range=0..2200)
number_slider_3 = Slider(1240, range=0..2200)
trigger_2 = Trigger(Interval=10, TimerInterval=10, Target=py3_2)  # disabled
json_dataset_path = Panel("C:\Users\giofo\Desktop\ARCHIVIO\MASTERS\MACAD\2_MACAD\0_MACAD DRIVE\AIA\STUDIO\AIA26_Studio\team_06\layout_inputs\RPLAN_Dataset_R-NB")
py3 = Python3Script(path=json_dataset_path, extension=".json")  # -> out, a; inputs path: String, extension: String
# ---------- py3: Python ----------
import os

# Check if the path is valid
if os.path.isdir(path):
    # Get all files in the directory
    all_files = os.listdir(path)
    full_paths = []
    
    for f in all_files:
        if f.endswith(extension):
            # Construct the full file path (e.g., C:\Folder\file.json)
            full_paths.append(os.path.join(path, f))
            
    # Sort the files alphabetically
    full_paths.sort()
    
    # Send the ordered list to output 'a'
    a = full_paths
else:
    a = []
# ---------- end py3 ----------

# ----
# connect (a) into list item layout indices to go through dataset
# Go through dataset
py3_2 = Python3Script(reset=Button())  # -> out, a, banned_indices
# ---------- py3_2: Python ----------
import scriptcontext as sc

# 1. ADD THE INDICES YOU WANT TO EXCLUDE HERE
banned_indices = []  # Just separate them with commas

# 2. Initialize or Reset
if reset or "count" not in sc.sticky:
    sc.sticky["count"] = 0
    # If 0 happens to be banned, skip to the first safe index
    while sc.sticky["count"] in banned_indices and sc.sticky["count"] < 100:
        sc.sticky["count"] += 1
else:
    # 3. Increment the counter
    if sc.sticky["count"] < 100:
        sc.sticky["count"] += 1
        
        # WHILE the current number is in the ban list, keep skipping forward
        while sc.sticky["count"] in banned_indices and sc.sticky["count"] < 100:
            sc.sticky["count"] += 1

# 4. Output the safe index
a = sc.sticky["count"]
b = banned_indices
# ---------- end py3_2 ----------

panel_2 = Panel(py3.a)

# ----
# layout indices
item = ListItem(List=py3.a, Index=py3_2.a, Wrap=invert(True))
file = ReadFile(File=item, PerLineParse=False)

banned_indices = Panel(py3_2.banned_indices)
panel_3 = Panel(py3_2.a)
item_2 = ListItem(List=py3.a, Index=banned_indices, Wrap=True)  # -> graft(Item)
panel_4 = Panel(item_2)
panel_5 = Panel(file)
fragment = TextFragment(Text=panel_4, Start=Slider(138, range=0..150))  # -> flatten(Fragment)
banned_layouts = Panel(fragment)

# ----
# RPLAN
# COMMON EROOR
# 1. Index was out of range. Must be non-negative and less than the size of the collection. (Parameter 'index') (line: 0)
item_3 = ListItem(List=py3.a, Index=py3_2.a, Wrap=True)  # -> graft(Item)
panel_6 = Panel(item_3)
fragment_2 = TextFragment(Text=panel_6, Start=Slider(140, range=0..150))  # -> flatten(Fragment)
layouts = Panel(fragment_2)
split = TextSplit(Text=layouts, Separators=".")
item_4 = ListItem(List=split, Index=0, Wrap=True)
layouts_2 = Panel(item_4)

# ----
# PLANFINDER
# dataset generation - don't trigger unless to change layouts
# WARNING: CLICK WRITE TO GENERATE JSONS
sample_count = Slider(50, range=1..250)
seed = Slider(395, range=0..999)
random_parameter_generator = Python3Script(seed=seed, sample_count=sample_count)  # -> a, b, c, d, e, f, g; inputs seed: Int32, sample_count: Int32
# ---------- random_parameter_generator: Python ----------
import random

lengths        = [4.5, 6.0, 7.5, 9.0, 10.5, 12.0, 13.5, 15.0, 16.5, 18.0]
widths         = [4.5, 6.0, 7.5, 9.0, 10.5, 12.0, 13.5, 15.0, 16.5, 18.0]
door_edges     = [0, 1, 2, 3]
door_positions = [0.2, 0.3, 0.4, 0.5, 0.6, 0.7, 0.8, 0.85, 0.9]
window_pats    = [0, 1, 2, 3, 4, 5]

counts = [len(lengths), len(widths), len(door_edges), len(door_positions), len(window_pats)]
total  = counts[0] * counts[1] * counts[2] * counts[3] * counts[4]

# Pre-filter: keep only non-square combinations
valid_indices = []
for idx in range(total):
    tmp = idx
    tmp //= counts[4]
    tmp //= counts[3]
    tmp //= counts[2]
    wi = tmp % counts[1]
    li = tmp // counts[1]
    if lengths[li] != widths[wi]:
        valid_indices.append(idx)

random.seed(int(seed))
n = min(int(sample_count), len(valid_indices))
chosen = sorted(random.sample(valid_indices, n))

out_L, out_W, out_de, out_dp, out_wp = [], [], [], [], []
for idx in chosen:
    tmp = idx
    wp  = tmp % counts[4]; tmp //= counts[4]
    dp  = tmp % counts[3]; tmp //= counts[3]
    de  = tmp % counts[2]; tmp //= counts[2]
    wi  = tmp % counts[1]; li   = tmp // counts[1]
    out_L.append(lengths[li])
    out_W.append(widths[wi])
    out_de.append(door_edges[de])
    out_dp.append(door_positions[dp])
    out_wp.append(window_pats[wp])

a = out_L
b = out_W
c = out_de
d = out_dp
e = out_wp
f = n
# ---------- end random_parameter_generator ----------
counter = Python3Script(reset=False, step=False, max_count=random_parameter_generator.f)  # -> a; inputs reset: Boolean, step: Boolean, max_count: String
# ---------- counter: Python ----------
import scriptcontext as sc

if reset or "pf_idx" not in sc.sticky:
    sc.sticky["pf_idx"] = 0
else:
    if sc.sticky["pf_idx"] < int(max_count) - 1:
        sc.sticky["pf_idx"] += 1

a = sc.sticky["pf_idx"]
# ---------- end counter ----------
panel_7 = Panel(counter)
list_item_2 = ListItem(List=random_parameter_generator.a, Index=counter, Wrap=True)
list_item_3 = ListItem(List=random_parameter_generator.b, Index=counter, Wrap=True)
list_item_4 = ListItem(List=random_parameter_generator.c, Index=counter, Wrap=True)
list_item_5 = ListItem(List=random_parameter_generator.d, Index=counter, Wrap=True)
list_item_6 = ListItem(List=random_parameter_generator.e, Index=counter, Wrap=True)
fit_settings = FitSettings(WidthInterior=100, WidthExterior=200, DownScaling=0.8, UpScaling=1.05, ThresholdScore=0, AmountOptions=5, UnitSystem=4)
layout_option = Slider(0, range=0..2)
panel_8 = Panel("D:\Marina\MaCAD 2025\3 SEMESTER\STUDIO\planfinder dataset\json")

boundary_length = Data(list_item_2)
boundary_width = Data(list_item_3)
window_pattern = Data(list_item_6)
door_edge_idx = Data(list_item_4)
door_position = Data(list_item_5)

panel_9 = Panel(boundary_width)
panel_10 = Panel(boundary_length)
multiplication = Multiplication(A=boundary_length, B=boundary_width)
area_sqm = Panel(multiplication)
rectangle = Rectangle(Plane=PlaneXY(0, 0, 0), XSize=boundary_length, YSize=boundary_width, Radius=0)  # -> Rectangle, Length
explode = Explode(Curve=rectangle.Rectangle, Recursive=True)  # -> Segments, Vertices
cull_index = CullIndex(List=explode.Vertices, Indices=-1, Wrap=True)
custom_preview = CustomPreview(
    Geometry=rectangle.Rectangle,
    Material={diffuse=RGB(32, 0, 221), emission=RGB(10, 0, 66), shine=0.5, specular=RGB(255, 255, 255), transparency=0})
window_edges_selection = Python3Script(edges=explode.Segments, door_edge_idx=door_edge_idx, window_pattern=window_pattern)  # -> window_edge_idxs; inputs edges: list of Curve, door_edge_idx: Int32, window_pattern: Int32
# ---------- window_edges_selection: Python ----------
candidates = [i for i in range(4) if i != door_edge_idx]
patterns = [[0], [1], [2], [0, 1], [0, 2], [1, 2]]
selected = patterns[window_pattern]
window_edge_idxs = [candidates[i] for i in selected]
# ---------- end window_edges_selection ----------
panel_11 = Panel(window_edges_selection)
list_item_7 = ListItem(List=explode.Segments, Index=window_edges_selection, Wrap=True)
list_item_8 = ListItem(List=explode.Segments, Index=door_edge_idx, Wrap=False)
door_edge = Data(list_item_8)
evaluate_curve = EvaluateCurve(Curve=reparameterize(door_edge), Parameter=door_position)  # -> Point, Tangent, Angle
window_facades = Data(list_item_7)
boundary = Data(rectangle.Rectangle)
entrance = Data(evaluate_curve.Point)
panel_12 = Panel(boundary)
plan_fit = PlanFit(
    Boundary=boundary,
    EntranceS=entrance,
    FacadeS=window_facades,
    Beds=-1,
    Baths=-1,
    Country=26,
    FitSettings=fit_settings,
    InHousePlans=False)
plans = Data(plan_fit)
choose_plan = ListItem(List=plans, Index=layout_option, Wrap=True)
deconstruct_plan = DeconstructPlan(Plan=choose_plan)  # -> InteriorWalls, ExteriorWalls, DoorCurves, Glass, WindowFrames, Furniture, Score, Rooms
deconstruct_room = DeconstructRoom(Room=deconstruct_plan.Rooms)  # -> Boundary, InteriorBoundary, Function
panel_13 = Panel(deconstruct_room.Function)
join_curves = JoinCurves(Curves=deconstruct_room.Boundary, Preserve=False)
filter_circulation_rooms = Python3Script(boundaries=deconstruct_room.Boundary, functions=deconstruct_room.Function)  # -> a; inputs boundaries: list, functions: list
# ---------- filter_circulation_rooms: Python ----------
a = [b for b, f in zip(boundaries, functions) if str(f).lower() == "circulation"]
# ---------- end filter_circulation_rooms ----------
region_union = RegionUnion(Curves=join_curves)  # -> simplify(Result)
json_serialiser = Python3Script(
    vertices=cull_index,
    area_sqm=area_sqm,
    length=boundary_length,
    width=boundary_width,
    door_edge_idx=door_edge_idx,
    door_point=entrance,
    door_position=door_position,
    window_edge_idxs=window_edges_selection,
    window_pattern=window_pattern,
    room_boundaries=deconstruct_room.Boundary,
    room_functions=deconstruct_room.Function,
    door_curves=deconstruct_plan.DoorCurves,
    facade_curves=deconstruct_plan.ExteriorWalls,
    circulation_crv=filter_circulation_rooms,
    window_frames=deconstruct_plan.WindowFrames,
    output_folder=panel_8,
    write=False)  # -> out, a, b; inputs vertices: list of Point3d, area_sqm: Double, length: Double, width: Double, door_edge_idx: Int32, door_point: Point3d, door_position: Double, window_edge_idxs: list of Int32, window_pattern: Int32, room_boundaries: list of Curve, room_functions: list of String, door_curves: list of Curve, facade_curves: list of Curve, circulation_crv: Curve, window_frames: list of Curve, output_folder: String, write: Boolean
# ---------- json_serialiser: Python ----------
import os, json, math
import Rhino.Geometry as rg
import scriptcontext as sc

PROGRAMS = {
    0: (["kitchen", "bath", "living", "circulation"], "any"),
    1: (["kitchen", "bath", "living", "circulation", "storage"], "any"),
    2: (["bed", "bath", "kitchen", "living", "circulation"], "connected"),
    3: (["bed", "bath", "kitchen", "living", "circulation", "storage"], "connected"),
    4: (["bed", "bed", "bath", "wc", "kitchen", "living", "circulation"], "connected"),
}
programs, conn_type = PROGRAMS[2]

layout_id = sc.sticky.get("pf_idx", 0)

def curve_to_pts(crv):
    if crv is None:
        return []
    nc = crv.ToNurbsCurve()
    if nc is None:
        return []
    return [(round(nc.Points[i].Location.X, 4), round(nc.Points[i].Location.Y, 4))
            for i in range(nc.Points.Count)]

def curve_area(crv):
    if crv is None:
        return 0
    amp = rg.AreaMassProperties.Compute(crv)
    return amp.Area if amp else 0

def pt_to_seg_dist(px, py, x1, y1, x2, y2):
    dx, dy = x2 - x1, y2 - y1
    if dx == 0 and dy == 0:
        return math.sqrt((px - x1)**2 + (py - y1)**2)
    t = max(0.0, min(1.0, ((px - x1)*dx + (py - y1)*dy) / (dx*dx + dy*dy)))
    return math.sqrt((px - (x1 + t*dx))**2 + (py - (y1 + t*dy))**2)

def dist_to_boundary(pt, boundary_coords):
    n = len(boundary_coords)
    best = float('inf')
    for i in range(n):
        x1, y1 = boundary_coords[i]
        x2, y2 = boundary_coords[(i+1) % n]
        d = pt_to_seg_dist(pt[0], pt[1], x1, y1, x2, y2)
        if d < best:
            best = d
    return best

def min_seg_dist(geom, px, py):
    n = len(geom)
    if n == 0:
        return float('inf')
    return min(pt_to_seg_dist(px, py, geom[k][0], geom[k][1], geom[(k+1)%n][0], geom[(k+1)%n][1]) for k in range(n))

def get_full_side_for_point(outline_coords, px, py, tol=0.5):
    n = len(outline_coords)
    best_dist = float('inf')
    best_seg = None
    for i in range(n):
        x1, y1 = outline_coords[i]
        x2, y2 = outline_coords[(i+1) % n]
        d = pt_to_seg_dist(px, py, x1, y1, x2, y2)
        if d < best_dist:
            best_dist = d
            best_seg = (x1, y1, x2, y2)
    if best_seg is None:
        return None
    x1, y1, x2, y2 = best_seg
    is_horiz = abs(y2 - y1) < abs(x2 - x1)
    coord_val = ((y1 + y2) / 2.0) if is_horiz else ((x1 + x2) / 2.0)
    if is_horiz:
        side_pts = sorted([p for p in outline_coords if abs(p[1] - coord_val) < tol], key=lambda p: p[0])
    else:
        side_pts = sorted([p for p in outline_coords if abs(p[0] - coord_val) < tol], key=lambda p: p[1])
    if len(side_pts) < 2:
        return None
    return (round(coord_val, 4), is_horiz, side_pts[0], side_pts[-1])

# Boundary from vertices
boundary_coords = [[round(p.X, 4), round(p.Y, 4)] for p in vertices]

# Build rooms
rooms = []
for rb, rf in zip(room_boundaries, room_functions):
    pts = curve_to_pts(rb)
    if not pts:
        continue
    rooms.append({
        "id": len(rooms),
        "type": rf.lower().strip(),
        "geometry": [list(p) for p in pts],
        "area": round(curve_area(rb), 4)
    })

# Actual outline from room union
outline_coords = boundary_coords
try:
    union_result = rg.Curve.CreateBooleanUnion([rb for rb in room_boundaries if rb is not None])
    if union_result and len(union_result) > 0:
        union_pts = curve_to_pts(union_result[0])
        if len(union_pts) >= 3:
            outline_coords = [list(p) for p in union_pts]
except:
    pass

# Door detection
DOOR_TOL = 0.15
BOUNDARY_TOL = 0.2

door_candidates = {}
for dc in door_curves:
    if dc is None:
        continue
    pts = curve_to_pts(dc)
    if not pts:
        continue
    mx = sum(p[0] for p in pts) / len(pts)
    my = sum(p[1] for p in pts) / len(pts)
    if dist_to_boundary((mx, my), boundary_coords) < BOUNDARY_TOL:
        continue
    connected = []
    for r in rooms:
        geom = r["geometry"]
        nr = len(geom)
        for j in range(nr):
            if pt_to_seg_dist(mx, my, geom[j][0], geom[j][1], geom[(j+1)%nr][0], geom[(j+1)%nr][1]) < DOOR_TOL:
                connected.append(r["id"])
                break
    if len(connected) >= 2:
        pair_key = frozenset(connected[:2])
        pair_list = list(pair_key)
        ra_geom = next((r["geometry"] for r in rooms if r["id"] == pair_list[0]), None)
        rb_geom = next((r["geometry"] for r in rooms if r["id"] == pair_list[1]), None)
        if ra_geom is None or rb_geom is None:
            continue
        combined = min_seg_dist(ra_geom, mx, my) + min_seg_dist(rb_geom, mx, my)
        if pair_key not in door_candidates or combined < door_candidates[pair_key][1]:
            door_candidates[pair_key] = ([round(mx,4), round(my,4)], combined)

doors = []
for i, (pair, (point, _)) in enumerate(door_candidates.items()):
    pair_list = list(pair)
    doors.append({
        "id": "door-{}".format(i + 1),
        "name": "Door {}".format(i + 1),
        "geometry": [point],
        "attributes": {"connectsRooms": [pair_list[0], pair_list[1]]}
    })
door_points = [data[0] for data in door_candidates.values()]

# Entrance door: compute exact position from Planfinder parameters
b_xs = [p[0] for p in boundary_coords]
b_ys = [p[1] for p in boundary_coords]
min_x, max_x = min(b_xs), max(b_xs)
min_y, max_y = min(b_ys), max(b_ys)
de = int(door_edge_idx)
dp = float(door_position)
if de == 0:   door_xy = [round(min_x + dp * (max_x - min_x), 4), min_y]
elif de == 1: door_xy = [max_x, round(min_y + dp * (max_y - min_y), 4)]
elif de == 2: door_xy = [round(max_x - dp * (max_x - min_x), 4), max_y]
else:         door_xy = [min_x, round(max_y - dp * (max_y - min_y), 4)]

# Circulation: full outline side where entrance door is
circulation = []
circ_side = None
if door_xy and outline_coords:
    side = get_full_side_for_point(outline_coords, door_xy[0], door_xy[1])
    if side:
        circ_side = side
        _, _, p_start, p_end = side
        circulation.append({"geometry": [list(p_start), list(p_end)]})

# Facades: use window_frames midpoints to find only window-bearing outline sides
facades = []
seen_sides = set()
wf_list = window_frames if hasattr(window_frames, '__iter__') else [window_frames]
for wf in wf_list:
    pts = curve_to_pts(wf)
    if not pts:
        continue
    mx = sum(p[0] for p in pts) / len(pts)
    my = sum(p[1] for p in pts) / len(pts)
    side = get_full_side_for_point(outline_coords, mx, my)
    if side is None:
        continue
    coord_val, is_horiz, p_start, p_end = side
    key = (round(coord_val, 3), is_horiz)
    if key not in seen_sides:
        seen_sides.add(key)
        facades.append({"geometry": [list(p_start), list(p_end)]})

record = {
    "layoutId": layout_id,
    "programType": programs,
    "connectivityType": conn_type,
    "outline": outline_coords,
    "boundary": boundary_coords,
    "door_point": door_xy,
    "door_points": door_points,
    "facades": facades,
    "circulation": circulation,
    "rooms": rooms,
    "doors": doors
}

# Update door_point to actual Planfinder door curve position on circulation wall
if circ_side:
    coord_val, is_horiz, cs_start, cs_end = circ_side
    best_dist = float('inf')
    actual_door = None
    for dc in door_curves:
        if dc is None:
            continue
        pts = curve_to_pts(dc)
        if not pts:
            continue
        mx = sum(p[0] for p in pts) / len(pts)
        my = sum(p[1] for p in pts) / len(pts)
        if is_horiz:
            if abs(my - coord_val) < 0.3 and cs_start[0] <= mx <= cs_end[0]:
                d = abs(my - coord_val)
                if d < best_dist:
                    best_dist = d
                    actual_door = [round(mx, 4), round(my, 4)]
        else:
            if abs(mx - coord_val) < 0.3 and cs_start[1] <= my <= cs_end[1]:
                d = abs(mx - coord_val)
                if d < best_dist:
                    best_dist = d
                    actual_door = [round(mx, 4), round(my, 4)]
    if actual_door:
        record["door_point"] = actual_door

a = json.dumps(record)
b = "no output_folder set"

if output_folder:
    if not rooms:
        b = "skipped: no rooms"
    else:
        try:
            fname = "L_L{}_W{}_de{}_dp{}_wp{}.json".format(
                round(float(length), 1),
                round(float(width), 1),
                int(door_edge_idx),
                round(float(door_position), 2),
                int(window_pattern)
            )
            filepath = os.path.join(str(output_folder), fname)
            with open(filepath, "w") as f:
                json.dump(record, f, indent=2)
            b = "saved: " + filepath

            # Screenshot
            import System.Drawing as sd
            view = sc.doc.Views.ActiveView
            if view:
                bmp = view.CaptureToBitmap(sd.Size(800, 600))
                if bmp:
                    img_path = filepath.replace('.json', '.png')
                    bmp.Save(img_path)

        except Exception as e:
            b = "error: " + str(e)
# ---------- end json_serialiser ----------
panel_14 = Panel(json_serialiser.b)
panel_15 = Panel(json_serialiser.a)

json_serialiser_2 = Python3Script(
    vertices=cull_index,
    area_sqm=area_sqm,
    length=boundary_length,
    width=boundary_width,
    door_edge_idx=door_edge_idx,
    door_point=entrance,
    door_position=door_position,
    window_edge_idxs=window_edges_selection,
    window_pattern=window_pattern,
    room_boundaries=deconstruct_room.Boundary,
    room_functions=deconstruct_room.Function,
    door_curves=deconstruct_plan.DoorCurves,
    facade_curves=deconstruct_plan.ExteriorWalls,
    circulation_crv=filter_circulation_rooms,
    window_frames=deconstruct_plan.WindowFrames,
    output_folder=panel_8,
    write=False)  # -> out, a, b; inputs vertices: list of Point3d, area_sqm: Double, length: Double, width: Double, door_edge_idx: Int32, door_point: Point3d, door_position: Double, window_edge_idxs: list of Int32, window_pattern: Int32, room_boundaries: list of Curve, room_functions: list of String, door_curves: list of Curve, facade_curves: list of Curve, circulation_crv: Curve, window_frames: list of Curve, output_folder: String, write: Boolean; disabled
# ---------- json_serialiser_2: Python ----------
import os, json, math
import Rhino.Geometry as rg
import scriptcontext as sc

PROGRAMS = {
    0: (["kitchen", "bath", "living", "circulation"], "any"),
    1: (["kitchen", "bath", "living", "circulation", "storage"], "any"),
    2: (["bed", "bath", "kitchen", "living", "circulation"], "connected"),
    3: (["bed", "bath", "kitchen", "living", "circulation", "storage"], "connected"),
    4: (["bed", "bed", "bath", "wc", "kitchen", "living", "circulation"], "connected"),
}
programs, conn_type = PROGRAMS[2]

layout_id = sc.sticky.get("pf_idx", 0)

def curve_to_pts(crv):
    if crv is None:
        return []
    nc = crv.ToNurbsCurve()
    if nc is None:
        return []
    return [(round(nc.Points[i].Location.X, 4), round(nc.Points[i].Location.Y, 4))
            for i in range(nc.Points.Count)]

def curve_area(crv):
    if crv is None:
        return 0
    amp = rg.AreaMassProperties.Compute(crv)
    return amp.Area if amp else 0

def pt_to_seg_dist(px, py, x1, y1, x2, y2):
    dx, dy = x2 - x1, y2 - y1
    if dx == 0 and dy == 0:
        return math.sqrt((px - x1)**2 + (py - y1)**2)
    t = max(0.0, min(1.0, ((px - x1)*dx + (py - y1)*dy) / (dx*dx + dy*dy)))
    return math.sqrt((px - (x1 + t*dx))**2 + (py - (y1 + t*dy))**2)

def dist_to_boundary(pt, boundary_coords):
    n = len(boundary_coords)
    best = float('inf')
    for i in range(n):
        x1, y1 = boundary_coords[i]
        x2, y2 = boundary_coords[(i+1) % n]
        d = pt_to_seg_dist(pt[0], pt[1], x1, y1, x2, y2)
        if d < best:
            best = d
    return best

def min_seg_dist(geom, px, py):
    n = len(geom)
    if n == 0:
        return float('inf')
    return min(pt_to_seg_dist(px, py, geom[k][0], geom[k][1], geom[(k+1)%n][0], geom[(k+1)%n][1]) for k in range(n))

def get_full_side_for_point(outline_coords, px, py, tol=0.5):
    n = len(outline_coords)
    best_dist = float('inf')
    best_seg = None
    for i in range(n):
        x1, y1 = outline_coords[i]
        x2, y2 = outline_coords[(i+1) % n]
        d = pt_to_seg_dist(px, py, x1, y1, x2, y2)
        if d < best_dist:
            best_dist = d
            best_seg = (x1, y1, x2, y2)
    if best_seg is None:
        return None
    x1, y1, x2, y2 = best_seg
    is_horiz = abs(y2 - y1) < abs(x2 - x1)
    coord_val = ((y1 + y2) / 2.0) if is_horiz else ((x1 + x2) / 2.0)
    if is_horiz:
        side_pts = sorted([p for p in outline_coords if abs(p[1] - coord_val) < tol], key=lambda p: p[0])
    else:
        side_pts = sorted([p for p in outline_coords if abs(p[0] - coord_val) < tol], key=lambda p: p[1])
    if len(side_pts) < 2:
        return None
    return (round(coord_val, 4), is_horiz, side_pts[0], side_pts[-1])

# Boundary from vertices
boundary_coords = [[round(p.X, 4), round(p.Y, 4)] for p in vertices]

# Build rooms
rooms = []
for rb, rf in zip(room_boundaries, room_functions):
    pts = curve_to_pts(rb)
    if not pts:
        continue
    rooms.append({
        "id": len(rooms),
        "type": rf.lower().strip(),
        "geometry": [list(p) for p in pts],
        "area": round(curve_area(rb), 4)
    })

# Actual outline from room union
outline_coords = boundary_coords
try:
    union_result = rg.Curve.CreateBooleanUnion([rb for rb in room_boundaries if rb is not None])
    if union_result and len(union_result) > 0:
        union_pts = curve_to_pts(union_result[0])
        if len(union_pts) >= 3:
            outline_coords = [list(p) for p in union_pts]
except:
    pass

# Door detection
DOOR_TOL = 0.15
BOUNDARY_TOL = 0.2

door_candidates = {}
for dc in door_curves:
    if dc is None:
        continue
    pts = curve_to_pts(dc)
    if not pts:
        continue
    mx = sum(p[0] for p in pts) / len(pts)
    my = sum(p[1] for p in pts) / len(pts)
    if dist_to_boundary((mx, my), boundary_coords) < BOUNDARY_TOL:
        continue
    connected = []
    for r in rooms:
        geom = r["geometry"]
        nr = len(geom)
        for j in range(nr):
            if pt_to_seg_dist(mx, my, geom[j][0], geom[j][1], geom[(j+1)%nr][0], geom[(j+1)%nr][1]) < DOOR_TOL:
                connected.append(r["id"])
                break
    if len(connected) >= 2:
        pair_key = frozenset(connected[:2])
        pair_list = list(pair_key)
        ra_geom = next((r["geometry"] for r in rooms if r["id"] == pair_list[0]), None)
        rb_geom = next((r["geometry"] for r in rooms if r["id"] == pair_list[1]), None)
        if ra_geom is None or rb_geom is None:
            continue
        combined = min_seg_dist(ra_geom, mx, my) + min_seg_dist(rb_geom, mx, my)
        if pair_key not in door_candidates or combined < door_candidates[pair_key][1]:
            door_candidates[pair_key] = ([round(mx,4), round(my,4)], combined)

doors = []
for i, (pair, (point, _)) in enumerate(door_candidates.items()):
    pair_list = list(pair)
    doors.append({
        "id": "door-{}".format(i + 1),
        "name": "Door {}".format(i + 1),
        "geometry": [point],
        "attributes": {"connectsRooms": [pair_list[0], pair_list[1]]}
    })
door_points = [data[0] for data in door_candidates.values()]


# Entrance door: midpoint of door curve closest to boundary
door_xy = boundary_coords[0] if boundary_coords else [0, 0]
best_d = float('inf')
for dc in door_curves:
    if dc is None:
        continue
    pts = curve_to_pts(dc)
    if not pts:
        continue
    mx = sum(p[0] for p in pts) / len(pts)
    my = sum(p[1] for p in pts) / len(pts)
    d = dist_to_boundary((mx, my), boundary_coords)
    if d < best_d:
        best_d = d
        door_xy = [round(mx,4), round(my,4)]

# Circulation: full outline side where entrance door is
circulation = []
if door_xy and outline_coords:
    side = get_full_side_for_point(outline_coords, door_xy[0], door_xy[1])
    if side:
        _, _, p_start, p_end = side
        circulation.append({"geometry": [list(p_start), list(p_end)]})

# Facades: use window_frames midpoints to find only window-bearing outline sides
facades = []
seen_sides = set()
wf_list = window_frames if hasattr(window_frames, '__iter__') else [window_frames]
for wf in wf_list:
    pts = curve_to_pts(wf)
    if not pts:
        continue
    mx = sum(p[0] for p in pts) / len(pts)
    my = sum(p[1] for p in pts) / len(pts)
    side = get_full_side_for_point(outline_coords, mx, my)
    if side is None:
        continue
    coord_val, is_horiz, p_start, p_end = side
    key = (round(coord_val, 3), is_horiz)
    if key not in seen_sides:
        seen_sides.add(key)
        facades.append({"geometry": [list(p_start), list(p_end)]})

record = {
    "layoutId": layout_id,
    "programType": programs,
    "connectivityType": conn_type,
    "outline": outline_coords,
    "boundary": boundary_coords,
    "door_point": door_xy,
    "door_points": door_points,
    "facades": facades,
    "circulation": circulation,
    "rooms": rooms,
    "doors": doors
}

a = json.dumps(record)
b = "no output_folder set"

if output_folder:
    try:
        fname = "L_L{}_W{}_de{}_dp{}_wp{}.json".format(
            round(float(length), 1),
            round(float(width), 1),
            int(door_edge_idx),
            round(float(door_position), 2),
            int(window_pattern)
        )
        filepath = os.path.join(str(output_folder), fname)
        with open(filepath, "w") as f:
            json.dump(record, f, indent=2)
        b = "saved: " + filepath
    except Exception as e:
        b = "error: " + str(e)
# ---------- end json_serialiser_2 ----------

# ---- group: RPLAN
# PLANFINDER Schema to Geo
layout_19_rplan = Text(flatten("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"))
extractor = Python3Script(json_str=json_serialiser.a)  # -> out, outline_curve, room_programs, room_curves, door_names, door_points, window_names, window_curves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; inputs json_str: String
# ---------- extractor: Python ----------
import json
import Rhino.Geometry as rg

# ==========================================
# 1. BULLETPROOF JSON PARSING
# ==========================================
layout = {}

if 'json_str' in globals() and json_str:
    try:
        # Check if Grasshopper passed a pre-parsed dictionary
        if type(json_str).__name__ == 'dict':
            layout = json_str
            
        else:
            raw_text = ""
            
            # Check if Grasshopper passed a list of strings (Multiline panel)
            if isinstance(json_str, (list, tuple)):
                raw_text = "".join([str(item) for item in json_str])
            else:
                # Force whatever it is into a standard python string
                raw_text = str(json_str)
            
            # Clean up Grasshopper's invisible formatting characters
            raw_text = raw_text.strip()
            
            # Parse the clean text
            if raw_text:
                layout = json.loads(raw_text)

    except Exception as e:
        print("JSON Parse Error: {}".format(e))
        layout = {} # Fallback so the component doesn't crash
else:
    print("Waiting for JSON input...")


# ==========================================
# 2. GEOMETRY FUNCTIONS
# ==========================================
def create_polyline(points, close=True):
    if not points or not isinstance(points, list): return None
    gh_pts = []
    for p in points:
        if isinstance(p, (list, tuple)) and len(p) >= 2:
            try:
                gh_pts.append(rg.Point3d(float(p[0]), float(p[1]), 0))
            except (ValueError, TypeError): continue
    if len(gh_pts) < 2: return None
    poly = rg.Polyline(gh_pts)
    if close and gh_pts[0].DistanceTo(gh_pts[-1]) > 0.001:
        poly.Add(gh_pts[0])
    return poly.ToPolylineCurve()

def create_point3d(geo_list):
    if not geo_list or not isinstance(geo_list, list) or len(geo_list) == 0: return None
    inner = geo_list[0]
    if isinstance(inner, list) and len(inner) >= 2:
        try: return rg.Point3d(float(inner[0]), float(inner[1]), 0)
        except: return None
    return None


# ==========================================
# 3. DATA EXTRACTION
# ==========================================
# All variables match the output pins on your component perfectly.

outline_curve = create_polyline(layout.get("outline", []), close=True)

room_programs = []
room_curves = []
for room in layout.get("rooms", []):
    room_programs.append(room.get("attributes", {}).get("program", "unknown"))
    room_curves.append(create_polyline(room.get("geometry", []), close=True))

door_names = []
door_points = []
seen_pairs = set()
for door in layout.get("doors", []):
    connected = door.get("attributes", {}).get("connectsRooms", [])
    if len(connected) >= 2:
        pair = tuple(sorted([connected[0], connected[1]]))
        if pair not in seen_pairs:
            seen_pairs.add(pair)
            door_names.append(door.get("name", "Door"))
            door_points.append(create_point3d(door.get("geometry", [])))


window_names = []
window_curves = []
for win in layout.get("windows", []):
    window_names.append(win.get("name", "Window"))
    window_curves.append(create_polyline(win.get("geometry", []), close=False))

furniture_names = []
furniture_curves = []
for fur in layout.get("furniture", []):
    furniture_names.append(fur.get("name", "Furniture"))
    furniture_curves.append(create_polyline(fur.get("geometry", []), close=True))

facade_curves = []
for fac in layout.get("facades", []):
    facade_curves.append(create_polyline(fac.get("geometry", []), close=False))

circulation_curves = []
for circ in layout.get("circulation", []):
    circulation_curves.append(create_polyline(circ.get("geometry", []), close=False))

# Entry door point
entry_pt = None
dp = layout.get("door_point")
if dp and len(dp) >= 2:
    entry_pt = rg.Point3d(float(dp[0]), float(dp[1]), 0)
# ---------- end extractor ----------

# ----
data = Data(deconstruct_plan.DoorCurves)
bounding_box = BoundingBox(Content=extractor.outline_curve, Plane=PlaneXY(0, 0, 0))  # -> Box, Box_2
panel_16 = Panel(extractor.room_programs)
panel_17 = Panel(extractor.entry_pt)
panel_18 = Panel(deconstruct_plan.DoorCurves)
box_corners = BoxCorners(Box=bounding_box.Box)  # -> CornerA, CornerB, CornerC, CornerD, CornerE, CornerF, CornerG, CornerH
polyline = PolyLine(Vertices=[box_corners.CornerA, box_corners.CornerB, box_corners.CornerC, box_corners.CornerD], Closed=True)
data_2 = Data(extractor.entry_pt)
data_3 = Data(extractor.door_points)

# ---- group: planfinder output
crv_bounds = Data(region_union)
crv_apartments = Data(deconstruct_room.Boundary)
crv_core_accessible = Data(filter_circulation_rooms)

# ----
extractor_2 = Python3Script(json_str=json_serialiser.b)  # -> out, outline_curve, room_programs, room_curves, door_names, door_points, window_names, window_curves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; inputs json_str: String; disabled
# ---------- extractor_2: Python ----------
import json
import Rhino.Geometry as rg

# ==========================================
# 1. BULLETPROOF JSON PARSING
# ==========================================
layout = {}

if 'json_str' in globals() and json_str:
    try:
        # Check if Grasshopper passed a pre-parsed dictionary
        if type(json_str).__name__ == 'dict':
            layout = json_str
            
        else:
            raw_text = ""
            
            # Check if Grasshopper passed a list of strings (Multiline panel)
            if isinstance(json_str, (list, tuple)):
                raw_text = "".join([str(item) for item in json_str])
            else:
                # Force whatever it is into a standard python string
                raw_text = str(json_str)
            
            # Clean up Grasshopper's invisible formatting characters
            raw_text = raw_text.strip()
            
            # Parse the clean text
            if raw_text:
                layout = json.loads(raw_text)

    except Exception as e:
        print("JSON Parse Error: {}".format(e))
        layout = {} # Fallback so the component doesn't crash
else:
    print("Waiting for JSON input...")


# ==========================================
# 2. GEOMETRY FUNCTIONS
# ==========================================
def create_polyline(points, close=True):
    if not points or not isinstance(points, list): return None
    gh_pts = []
    for p in points:
        if isinstance(p, (list, tuple)) and len(p) >= 2:
            try:
                gh_pts.append(rg.Point3d(float(p[0]), float(p[1]), 0))
            except (ValueError, TypeError): continue
    if len(gh_pts) < 2: return None
    poly = rg.Polyline(gh_pts)
    if close and gh_pts[0].DistanceTo(gh_pts[-1]) > 0.001:
        poly.Add(gh_pts[0])
    return poly.ToPolylineCurve()

def create_point3d(geo_list):
    if not geo_list or not isinstance(geo_list, list) or len(geo_list) == 0: return None
    inner = geo_list[0]
    if isinstance(inner, list) and len(inner) >= 2:
        try: return rg.Point3d(float(inner[0]), float(inner[1]), 0)
        except: return None
    return None


# ==========================================
# 3. DATA EXTRACTION
# ==========================================
# All variables match the output pins on your component perfectly.

outline_curve = create_polyline(layout.get("outline", []), close=True)

room_programs = []
room_curves = []
for room in layout.get("rooms", []):
    room_programs.append(room.get("attributes", {}).get("program", "unknown"))
    room_curves.append(create_polyline(room.get("geometry", []), close=True))

door_names = []
door_points = []
for door in layout.get("doors", []):
    door_names.append(door.get("name", "Door"))
    door_points.append(create_point3d(door.get("geometry", [])))

window_names = []
window_curves = []
for win in layout.get("windows", []):
    window_names.append(win.get("name", "Window"))
    window_curves.append(create_polyline(win.get("geometry", []), close=False))

furniture_names = []
furniture_curves = []
for fur in layout.get("furniture", []):
    furniture_names.append(fur.get("name", "Furniture"))
    furniture_curves.append(create_polyline(fur.get("geometry", []), close=True))

facade_curves = []
for fac in layout.get("facades", []):
    facade_curves.append(create_polyline(fac.get("geometry", []), close=False))

circulation_curves = []
for circ in layout.get("circulation", []):
    circulation_curves.append(create_polyline(circ.get("geometry", []), close=False))
# ---------- end extractor_2 ----------

# ----
# PLANFINDER JSON Dataset
trigger_3 = Trigger(Interval=10, TimerInterval=10, Target=py3_4)  # disabled
json_dataset_path_2 = Panel("C:\Users\mosmo\OneDrive\Desktop\AIA Studio\AIA26_Studio\team_06\layout_inputs\Planfinder_Dataset")
py3_3 = Python3Script(path=json_dataset_path_2, extension=".json")  # -> out, a; inputs path: String, extension: String; same code as py3

# ----
# connect (a) into list item layout indices to go through dataset
# Go through dataset
py3_4 = Python3Script(reset=Button())  # -> out, a, banned_indices
# ---------- py3_4: Python ----------
import scriptcontext as sc

# 1. ADD THE INDICES YOU WANT TO EXCLUDE HERE
banned_indices = []  # Just separate them with commas

# 2. Initialize or Reset
if reset or "count" not in sc.sticky:
    sc.sticky["count"] = 0
    # If 0 happens to be banned, skip to the first safe index
    while sc.sticky["count"] in banned_indices and sc.sticky["count"] < 100:
        sc.sticky["count"] += 1
else:
    # 3. Increment the counter
    if sc.sticky["count"] < 66:
        sc.sticky["count"] += 1
        
        # WHILE the current number is in the ban list, keep skipping forward
        while sc.sticky["count"] in banned_indices and sc.sticky["count"] < 100:
            sc.sticky["count"] += 1

# 4. Output the safe index
a = sc.sticky["count"]
b = banned_indices
# ---------- end py3_4 ----------

panel_19 = Panel(py3_3.a)

# ----
# layout indices
item_5 = ListItem(List=py3_3.a, Index=py3_4.a, Wrap=invert(True))
file_2 = ReadFile(File=item_5, PerLineParse=False)

banned_indices_2 = Panel(py3_4.banned_indices)
panel_20 = Panel(py3_4.a)
item_6 = ListItem(List=py3_3.a, Index=banned_indices_2, Wrap=True)  # -> graft(Item)
panel_21 = Panel(file_2)
panel_22 = Panel(item_6)
fragment_3 = TextFragment(Text=panel_22, Start=Slider(138, range=0..150))  # -> flatten(Fragment)
banned_layouts_2 = Panel(fragment_3)

# ----
# LAYOUT FILTERING
# COMMON EROOR
# 1. Index was out of range. Must be non-negative and less than the size of the collection. (Parameter 'index') (line: 0)
number_slider_4 = Slider(97, range=0..150)
item_7 = ListItem(List=item_5, Index=py3_4.a, Wrap=True)  # -> graft(Item)
panel_23 = Panel(item_7)
fragment_4 = TextFragment(Text=panel_23, Start=number_slider_4)  # -> flatten(Fragment)
layouts_3 = Panel(fragment_4)
split_2 = TextSplit(Text=layouts_3, Separators=".json")
item_8 = ListItem(List=split_2, Index=0, Wrap=True)

python_3_script_2 = Python3Script(x=layouts_3, y="-5")  # -> out, a; inputs x: String, y: Int32
# ---------- python_3_script_2: Python ----------
a = str(x[:y])
# ---------- end python_3_script_2 ----------

layouts_name = Panel(python_3_script_2.a)

# ----
# Target Layout
crv_bounds_2 = Curve(graft(polyline))
crv_circulation = Curve(flatten(extractor.circulation_curves))
crv_facade = Curve(simplify(extractor.facade_curves))
crv_apt_units = Curve(simplify(graft(crv_bounds_2)))
crv_bounds_3 = Curve(crv_apt_units)
flip = FlipCurve(Curve=crv_bounds_3)  # -> Curve, Flag

c_intersection = CSharpScript(
    crvA=crv_facade,
    crvB=crv_bounds_2,
    Reference=["D:\MARINA\MACAD 2025\3 SEMESTER\STUDIO\HYPERGRAPH\HYPERGRAPH\RESEARCHGEOMETRYLIBRARY\RGEOLIB\BIN\DEBUG\MathNet.Numerics.dll", "D:\MARINA\MACAD 2025\3 SEMESTER\STUDIO\HYPERGRAPH\HYPERGRAPH\RESEARCHGEOMETRYLIBRARY\RGEOLIB\BIN\DEBUG\RGeoLib.dll", "D:\MARINA\MACAD 2025\3 SEMESTER\STUDIO\HYPERGRAPH\HYPERGRAPH\RESEARCHGEOMETRYLIBRARY\RGEOLIB\BIN\DEBUG\DelaunatorSharp.dll", "D:\MARINA\MACAD 2025\3 SEMESTER\STUDIO\HYPERGRAPH\HYPERGRAPH\RESEARCHGEOMETRYLIBRARY\RGEOLIB\BIN\DEBUG\Clipper2Lib.dll"])  # -> out, simplify(A), B; inputs crvA: list of Polyline, crvB: list of Polyline
# ---------- c_intersection: C# usings ----------
using System.Linq;
using RGeoLib;
# ---------- c_intersection: C# ----------
    List<NLine> linesREF = RhConvert.RhPolylineListToNLineList(crvA);

    List<NLine> linesA = RhConvert.RhPolylineListToNLineList(crvA);
    List<NLine> linesB = RhConvert.RhPolylineListToNLineList(crvB);

    List<NLine> linesC = RIntersection.lineListBooleanIntersectionTol(linesB, linesA, 0.01);

    // conform lines to face
    List<Vec3d> vecOut = new List<Vec3d>();
    for (int i = 0;i < linesC.Count;i++)
    {
      // get closest line in list of lines
      List<NLine> SortedList = linesREF.OrderBy(o => Vec3d.Distance(o.MidPoint, linesC[i].MidPoint)).ToList();
      vecOut.Add(SortedList[0].MidPoint);
      double dotProd = Vec3d.DotProduct(linesC[i].Direction, SortedList[0].Direction);
      if (dotProd <= 0.005)
      {
        linesC[i].FlipLine();
      }
    }


    A = RhConvert.NLineListToRhLineCurveList(linesC);
    B = RhConvert.Vec3dListToRhPoint3dList(vecOut);
# ---------- end c_intersection ----------
c_intersection_2 = CSharpScript(
    crvA=crv_bounds_2,
    crvB=crv_circulation,
    Reference=["D:\MARINA\MACAD 2025\3 SEMESTER\STUDIO\HYPERGRAPH\HYPERGRAPH\RESEARCHGEOMETRYLIBRARY\RGEOLIB\BIN\DEBUG\MathNet.Numerics.dll", "D:\MARINA\MACAD 2025\3 SEMESTER\STUDIO\HYPERGRAPH\HYPERGRAPH\RESEARCHGEOMETRYLIBRARY\RGEOLIB\BIN\DEBUG\RGeoLib.dll", "D:\MARINA\MACAD 2025\3 SEMESTER\STUDIO\HYPERGRAPH\HYPERGRAPH\RESEARCHGEOMETRYLIBRARY\RGEOLIB\BIN\DEBUG\DelaunatorSharp.dll", "D:\MARINA\MACAD 2025\3 SEMESTER\STUDIO\HYPERGRAPH\HYPERGRAPH\RESEARCHGEOMETRYLIBRARY\RGEOLIB\BIN\DEBUG\Clipper2Lib.dll"])  # -> out, simplify(A), B; inputs crvA: list of Polyline, crvB: list of Polyline
# ---------- c_intersection_2: C# ----------
    List<NLine> linesREF = RhConvert.RhPolylineListToNLineList(crvA);

    List<NLine> linesA = RhConvert.RhPolylineListToNLineList(crvA);
    List<NLine> linesB = RhConvert.RhPolylineListToNLineList(crvB);

    List<NLine> linesC = RIntersection.lineListBooleanIntersectionTol(linesB, linesA, 0.01);

    // conform lines to face
    List<Vec3d> vecOut = new List<Vec3d>();
    for (int i = 0;i < linesC.Count;i++)
    {
      // get closest line in list of lines
      List<NLine> SortedList = linesREF.OrderBy(o => Vec3d.Distance(o.MidPoint, linesC[i].MidPoint)).ToList();
      vecOut.Add(SortedList[0].MidPoint);
      double dotProd = Vec3d.DotProduct(linesC[i].Direction, SortedList[0].Direction);
      if (dotProd <= 0.005)
      {
        linesC[i].FlipLine();
      }
    }

    List<NLine> outLines = new List<NLine>();
    
    for (int i = 0; i < linesC.Count; i++)
    {
      if (linesC[i].Length > 0.8)
      {
        outLines.Add(linesC[i]);
      }
    }
    
    //A = RhConvert.NLineListToRhLineCurveList(linesC);
    A = RhConvert.NLineListToRhLineCurveList(outLines);

    B = RhConvert.Vec3dListToRhPoint3dList(vecOut);
# ---------- end c_intersection_2 ----------

crv_facade_2 = Curve(c_intersection.A)
crv_circulation_2 = Curve(c_intersection_2.A)
join = JoinCurves(Curves=crv_facade_2, Preserve=False)
join_2 = JoinCurves(Curves=crv_circulation_2, Preserve=False)
simplify = SimplifyCurve(Curve=join)  # -> Curve, Simplified
simplify_2 = SimplifyCurve(Curve=join_2)  # -> Curve, Simplified

explode_2 = Explode(Curve=simplify_2.Curve, Recursive=True)  # -> Segments, Vertices
simplify_outline = SimplifyCurve(Curve=crv_bounds_3)  # -> Curve, Simplified
explode_3 = Explode(Curve=simplify.Curve, Recursive=True)  # -> flatten(Segments), Vertices

# ----
# Reference Layout
# WITH TIMER
c_script = CSharpScript(
    crv=extractor.room_curves,
    u=extractor.room_programs,
    ptCirc=extractor.door_points,
    crvBounds=simplify_outline.Curve,
    crvFacade=explode_3.Segments,
    crvCirc=explode_2.Segments,
    Reference=["D:\MARINA\MACAD 2025\3 SEMESTER\STUDIO\HYPERGRAPH\HYPERGRAPH\RESEARCHGEOMETRYLIBRARY\RGEOLIB\BIN\DEBUG\MathNet.Numerics.dll", "D:\MARINA\MACAD 2025\3 SEMESTER\STUDIO\HYPERGRAPH\HYPERGRAPH\RESEARCHGEOMETRYLIBRARY\RGEOLIB\BIN\DEBUG\RGeoLib.dll", "D:\MARINA\MACAD 2025\3 SEMESTER\STUDIO\HYPERGRAPH\HYPERGRAPH\RESEARCHGEOMETRYLIBRARY\RGEOLIB\BIN\DEBUG\Microsoft.Bcl.AsyncInterfaces.dll", "D:\MARINA\MACAD 2025\3 SEMESTER\STUDIO\HYPERGRAPH\HYPERGRAPH\RESEARCHGEOMETRYLIBRARY\RGEOLIB\BIN\DEBUG\System.Buffers.dll", "D:\MARINA\MACAD 2025\3 SEMESTER\STUDIO\HYPERGRAPH\HYPERGRAPH\RESEARCHGEOMETRYLIBRARY\RGEOLIB\BIN\DEBUG\System.Memory.dll", "D:\MARINA\MACAD 2025\3 SEMESTER\STUDIO\HYPERGRAPH\HYPERGRAPH\RESEARCHGEOMETRYLIBRARY\RGEOLIB\BIN\DEBUG\System.Numerics.Vectors.dll", "D:\MARINA\MACAD 2025\3 SEMESTER\STUDIO\HYPERGRAPH\HYPERGRAPH\RESEARCHGEOMETRYLIBRARY\RGEOLIB\BIN\DEBUG\System.Runtime.CompilerServices.Unsafe.dll", "D:\MARINA\MACAD 2025\3 SEMESTER\STUDIO\HYPERGRAPH\HYPERGRAPH\RESEARCHGEOMETRYLIBRARY\RGEOLIB\BIN\DEBUG\System.Text.Encodings.Web.dll", "D:\MARINA\MACAD 2025\3 SEMESTER\STUDIO\HYPERGRAPH\HYPERGRAPH\RESEARCHGEOMETRYLIBRARY\RGEOLIB\BIN\DEBUG\System.Text.Json.dll", "D:\MARINA\MACAD 2025\3 SEMESTER\STUDIO\HYPERGRAPH\HYPERGRAPH\RESEARCHGEOMETRYLIBRARY\RGEOLIB\BIN\DEBUG\System.Threading.Tasks.Extensions.dll", "D:\MARINA\MACAD 2025\3 SEMESTER\STUDIO\HYPERGRAPH\HYPERGRAPH\RESEARCHGEOMETRYLIBRARY\RGEOLIB\BIN\DEBUG\System.ValueTuple.dll"])  # -> out, splitGraphJson, boundsJson, facadeJson, circulationJson, apt; inputs database: String, country: String, city: String, name: String, crv: list of Polyline, u: list of String, ptCirc: list of Point3d, crvBounds: Polyline, crvFacade: list of Polyline, crvCirc: list of Polyline, id: String
# ---------- c_script: C# ----------
    // IMPORT
    List<Vec3d> inputPt = RhConvert.RhPointListToVec3dList(ptCirc);
    NFace bounds = RhConvert.RhPolylineToNFace(crvBounds);
    List<NLine> facade = RhConvert.RhPolylineListToNLineList(crvFacade);
    List<NLine> circulation = RhConvert.RhPolylineListToNLineList(crvCirc);

    // CONVERT
    NMesh inputMesh = RhConvert.RhPolylineListToNMeshWithNames(crv, u);
    DataNode rootNode = DataNode.dataNodeFromNMeshAndBoundsWithConnectivity(inputMesh, bounds, inputPt);

    // JSON
    splitGraphJson = DataNode.serializeDataNode(rootNode);
    boundsJson = NFace.serializeNFace(bounds);
    facadeJson = NLine.serializeNLineList(facade);
    circulationJson = NLine.serializeNLineList(circulation);

    string jsonBounds = NFace.serializeNFace(bounds);
    string jsonFacade = NLine.serializeNLineList(facade);
    string jsonCirculation = NLine.serializeNLineList(circulation);
    string jsonSplit = DataNode.serializeDataNode(rootNode);


    Apartment newApartment = new Apartment(jsonBounds, jsonFacade, jsonCirculation, jsonSplit);
    newApartment.id = id;
    newApartment.database = database;
    newApartment.country = country;
    newApartment.city = city;
    newApartment.name = name;

    apt = newApartment;
# ---------- end c_script ----------

# ----
# Connect above to test layout adaption on its own boundary
target_boundary = Curve(simplify_outline.Curve)
target_circulation = Curve(simplify(explode_2.Segments))
target_facades = Curve(simplify(flatten(explode_3.Segments)))
reference_layout = Data(flatten(c_script.apt))

panel_24 = Panel(target_facades)
panel_25 = Panel(c_script.apt)

# ----
# Apply Layout to Target
apartment_number = Slider(0, range=0..100)
reference_layout_2 = Data(flatten(reference_layout))
layout = Panel(layouts_name)
target_facades_2 = Curve(simplify(flatten(target_facades)))
target_circulation_2 = Curve(simplify(target_circulation))

target_boundary_2 = Curve(target_boundary)

panel_26 = Panel(target_facades_2)

# ----
# Reference Layout
# WITH TIMER 2
c_script_2 = CSharpScript(
    targetB=target_boundary_2,
    targetC=target_circulation_2,
    targetF=target_facades_2,
    bldg=layout,
    aptNum=apartment_number,
    areaFilter=Slider(1, range=0..1),
    refAPT=reference_layout_2,
    Reference=["D:\MARINA\MACAD 2025\3 SEMESTER\STUDIO\HYPERGRAPH\HYPERGRAPH\RESEARCHGEOMETRYLIBRARY\RGEOLIB\BIN\DEBUG\MathNet.Numerics.dll", "D:\MARINA\MACAD 2025\3 SEMESTER\STUDIO\HYPERGRAPH\HYPERGRAPH\RESEARCHGEOMETRYLIBRARY\RGEOLIB\BIN\DEBUG\RGeoLib.dll", "D:\MARINA\MACAD 2025\3 SEMESTER\STUDIO\HYPERGRAPH\HYPERGRAPH\RESEARCHGEOMETRYLIBRARY\RGEOLIB\BIN\DEBUG\Dbscan.dll"])  # -> out, apts, aptsF, aptsRef, failedApt; inputs targetB: Polyline, targetC: list of Polyline, targetF: list of Polyline, bldg: String, aptNum: Int32, areaFilter: Double, refAPT: list
# ---------- c_script_2: C# usings ----------
using System.Linq;
using RGeoLib;
using RGeoLib.BuildingSolver;
# ---------- c_script_2: C# ----------
    // GLOBAL VALUES

    NFace boundsTarget = RhConvert.RhPolylineToNFace(targetB);

    NFace boundsTargetFlipped = RhConvert.RhPolylineToNFace(targetB);
    boundsTargetFlipped.flipRH();


    List<Apartment> referenceList = refAPT.Cast<Apartment>().ToList();


    List<NLine> circTarget = RhConvert.RhPolylineListToNLineList(targetC);
    List<NLine> facTarget = RhConvert.RhPolylineListToNLineList(targetF);

    List<NLine> circTargetF = RhConvert.RhPolylineListToNLineList(targetC);
    List<NLine> facTargetF = RhConvert.RhPolylineListToNLineList(targetF);

    for (int i = 0;i < circTargetF.Count; i++)
    {
      circTargetF[i].FlipLineWithhSwap();
    }
    for (int i = 0;i < circTargetF.Count; i++)
    {
      facTargetF[i].FlipLineWithhSwap();
    }

    Apartment targetApartment = new Apartment(boundsTarget, facTarget, circTarget);
    Apartment targetApartmentFlipped = new Apartment(boundsTargetFlipped, facTargetF, circTargetF);


    List<Apartment> outAptList = new List<Apartment>();

    // ⏱️ FILTER
    // Run the solver in the background so it doesn't freeze
    var task = System.Threading.Tasks.Task.Run(() =>
    {
      return Apartment.fitApartment(bldg, aptNum, referenceList, targetApartment, areaFilter, false, false);
    });

    // Wait for a maximum of 3000 milliseconds (3 seconds).
    if (task.Wait(3000))
    {
      // It solved it quickly! Save the good result.
      outAptList = task.Result;
    }
    else
    {
      // It got stuck in an infinite loop.
      // Throw an orange warning (not a red crash) and output an empty list so it moves on.
      Component.AddRuntimeMessage(GH_RuntimeMessageLevel.Warning, "Skipped a bad apartment! Took longer than 3 seconds.");

      //  THE BLACKLIST EXPORT
      failedApt = bldg + "_Apt_" + aptNum.ToString();
    }
    //List<Apartment> outAptList = Apartment.forceFitApartments(bldg, aptNum, referenceList, targetApartment);

    //List<Apartment> outAptListF = fitApartment(bldg, aptNum, referenceList, targetApartmentFlipped, areaFilter, false, false);

    apts = outAptList;
    //aptsF = outAptListF;

    List<Apartment> refList = new List<Apartment>();

    for (int i = 0;i < outAptList.Count; i++)
    {
      refList.Add(outAptList[i].referenceApartment);
    }

    aptsRef = refList;
# ---------- c_script_2: C# additional code ----------
  public static List<Apartment> fitApartment(string buildingName, int aptNum, List<Apartment> referenceList, Apartment targetApartment, double areaFilter = 0.15, bool cullAccess=true, bool sortByShape=true)
  {
    List<Apartment> chosenAreaRef = Apartment.preFilterByArea(referenceList, targetApartment, areaFilter);
    List<Apartment> apartmentOut = Apartment.createApartmentsFromReference(chosenAreaRef, targetApartment);

    if (cullAccess)
      apartmentOut = Apartment.preFilterByAccessAndProgram(apartmentOut);

    if (sortByShape)
      apartmentOut = Apartment.sortAptsByRoomShape(apartmentOut);

    // Add global properties
    for (int i = 0; i < apartmentOut.Count; i++)
    {
      apartmentOut[i].eval.building = buildingName;
      apartmentOut[i].eval.apartmentNum = aptNum;
    }
    return apartmentOut;
  }
# ---------- end c_script_2 ----------

panel_27 = Panel(c_script_2.out)

# ---- group: WRITE BLACKLIST
rec = DataRecorder(c_script_2.failedApt, DataLimit=-10, RecordData=True)
clean = CleanTree(RemoveNulls=True, RemoveInvalid=True, RemoveEmpty=invert(False), Tree=rec)
panel_28 = Panel(clean)
py3_5 = Python3Script(textData=flatten(panel_28), filePath=path, writeToggle=Toggle(False))  # -> out, a; inputs textData: list of String
# ---------- py3_5: Python ----------
"""
Inputs:
    textData: The list of failed apartments (Set to 'List Access' + 'Flatten')
    filePath: The full path to your .txt file 
    writeToggle: A Boolean Toggle (True = Overwrite file)
"""
import os

if writeToggle:
    if not filePath:
        print("Error: Please provide a valid file path.")
    else:
        try:
            with open(filePath, 'w') as f:
                # 1. If Grasshopper gives us a List
                if isinstance(textData, list) or type(textData) is tuple:
                    for item in textData:
                        if item is not None:
                            # Force split any hidden multiline strings inside the list
                            lines = str(item).splitlines()
                            for line in lines:
                                if line.strip(): # Ignore completely empty blank lines
                                    f.write(line.strip() + '\n')
                
                # 2. If Grasshopper gives us one giant Multiline String
                else:
                    if textData is not None:
                        lines = str(textData).splitlines()
                        for line in lines:
                            if line.strip():
                                f.write(line.strip() + '\n')
            
            print("Boom. Multiline data split and overwritten successfully!")
            
        except Exception as e:
            print("Failed to write file. Error: " + str(e))
else:
    print("Waiting... Switch 'writeToggle' to True to overwrite the file.")
# ---------- end py3_5 ----------

# ----
panel_29 = Panel(py3_5.out)
